# Grasshopper definition starttemplate.gh (Grasshopper 1.0.8)
# plug-ins: Robots

crv = Curve(<curve referenced from the Rhino model>)

# ---- group: toolpath
divide_curve = DivideCurve(Curve=flatten(crv), Count=Slider(24, range=0..1000), Kinks=False)  # -> Points, Tangents, Parameters
xy_plane = XYPlane(Origin=divide_curve.Points)
flip_plane = FlipPlane(Plane=xy_plane, ReverseX=False, ReverseY=False, SwapAxes=True)

# ---- group: Robot setup
xy_plane_2 = XYPlane(Origin=Point(0, 0, 0))
line = Line(Line((0, 0, 0), (0, 0, 84.60529284)))
list = RobotsLibrary({"UR3e", "UR5e", "UR10e", "UR16e", "UR3", "UR5", "UR10"}, selected="UR10e", Type=0)
rotate_axis = RotateAxis(Geometry=xy_plane_2, Angle=Slider(90, range=-180..180), Axis=line)  # -> Geometry, Transform
load_robot_system = LoadRobotSystem(Name=list, Base=xy_plane_2)

# ---- group: make targets
list_2 = FlagFields({"Shoulder": 1, "Elbow": 2, "Wrist": 4}, selected=[])
create_tool = CreateTool(Name="claye", TCP="-95.39,0.87,87.03", Weight=0)  # -> Tool, TCP
list_3 = ValueList({"Joint", "Linear"}, selected="Linear")
create_target = CreateTarget(Plane=flip_plane, RobConf=list_2, Motion=list_3, Tool=create_tool.Tool, Zone=Slider(1, range=-0.9..10), IsCartesian=True)

# ----
message = Message(Message="Ready?")

# ---- group: make program
create_program = CreateProgram(Name="rhino001", RobotSystem=load_robot_system, Targets=create_target, InitCommands=message, StepSize=1)  # -> Program, Code, Duration, Warnings, Errors
program_simulation = ProgramSimulation(Program=create_program.Program, Time=Slider(1, range=0.001..1), Normalized=True)  # -> SystemMeshes, JointRotations, Plane, Index, Time, Program, Errors
panel = Panel([create_program.Errors, create_program.Warnings])

# ----
path = FilePath("C:\Users\luigi\Desktop\")
panel_2 = Panel(create_program.Code)
saveprog = SaveProgram(Program=create_program.Program, Folder=path)
degrees = Degrees(Radians=program_simulation.JointRotations)

# ---- group: remote control
remote_connection = RemoteConnection(Program=program_simulation.Program, IP="192.168.1.10", Upload=Button(), Play=Button(), Pause=Button())
panel_3 = Panel(degrees)

# ----
panel_4 = Panel(remote_connection)
