# Grasshopper definition KR10_template_drawing_vertical.gh (Grasshopper 1.0.7)
# plug-ins: KUKA|prc - parametric robot control

# ---- group: Source Surface
# Source Surface
pt = Point(<point referenced from the Rhino model>)
pt_2 = Point(<point referenced from the Rhino model>)
pt_3 = Point(<point referenced from the Rhino model>)
pt_4 = Point(<point referenced from the Rhino model>)
srf4pt = _4PointSurface(CornerA=pt, CornerB=pt_2, CornerC=pt_3, CornerD=pt_4)
points = PointList(Points=[pt, pt_2, pt_3, pt_4], Size=Slider(46, range=1..100))
flip = Flip(Surface=srf4pt)  # -> Surface, Result

# ----
# Map Selected Curves to Target Surface
selected_crvs = Curve([<curve referenced from the Rhino model> x194])

# ---- group: Calibrated Plane / Set XYZ coordinates
# Calibrate Vertical Target Surface
pt_5 = Point(Point(942.14, 0, 700))
pt_6 = Point(Point(946.33, -325, 250))
pt_7 = Point(Point(932, 325, 250))

# ---- group: Calibrated Plane
# Procedure:
# 
# 1. Insert Tool
# 2. Calibrate Tool (KUKA 4-point Calibration)
# 3. Set Tool Params (GH)
# 4. Run calibrate_vert_srf.src and get 3 pts for vertical surface (KUKA)
# 5. Update Target Surface pts (GH)
# 6. Verify Reachability (GH)
# 7. Save .src File (GH)
pl_3pt = Plane3Pt(PointA=pt_5, PointB=pt_6, PointC=pt_7)
points_2 = PointList(Points=[pt_5, pt_6, pt_7], Size=Slider(65, range=1..100))

# ---- group: Convert to Surface
number_slider = Slider(1100, range=1..1100)
planesrf = PlaneSurface(Plane=pl_3pt, XSize=number_slider, YSize=number_slider)

# ---- group: Rotate Plane / centroid
sdivide = DivideSurface(Surface=planesrf, UCount=2, VCount=2)  # -> flatten(Points), Normals, Parameters
item = ListItem(List=sdivide.Points, Index=Slider(4, range=0..8), Wrap=True)

# ----
geo = Geometry(<brep referenced from the Rhino model>)
save = Button()

# ---- group: Add Approach & Retract Planes
# Build Toolpaths
number_slider_2 = Slider(-30, range=-360..360)

# ----
int = Integer(1)
wait = WaitKUKAPrc(KUKAPrcWait=1)
custom_tool = CustomToolKUKAPrc(
    CustomToolGeometry=geo,
    toolid=6,
    toolvala=0,
    toolvalb=0,
    toolvalc=0,
    toolvalx=-89.927,
    toolvaly=10.259,
    toolvalz=140.779,
    valuesset=True)
kr6_10_r1100 = AgilusKR610R1100Robot(infiniterot=False)
knob = ControlKnob(Decimals=2, Limit=True, Maximum=1, Minimum=0, Range=1, Value=0)

# ---- group: Curves Mapped to Target Surface
curves_to_draw = Curve(selected_crvs)
source_surface = Surface(flip.Surface)

# ---- group: Fine Tune Positioning
deplane = DeconstructPlane(Plane=planesrf)  # -> Origin, XAxis, YAxis, ZAxis
multiplication = Multiplication(A=deplane.XAxis, B=Slider(409.063, range=-1000..1000))
multiplication_2 = Multiplication(A=deplane.YAxis, B=Slider(-339.393, range=-1000..1000))
multiplication_3 = Multiplication(A=deplane.ZAxis, B=Slider(0, range=-1000..1000))

# ---- group: Rotate Plane
rot3d = Rotate3D(Geometry=planesrf, Angle=degrees(Slider(216, range=0..360)), Center=item, Axis=deplane.ZAxis)  # -> Geometry, Transform

# ---- group: Fine Tune Positioning (continued)
move = Move(Geometry=rot3d.Geometry, Motion=multiplication)  # -> Geometry, Transform
move_2 = Move(Geometry=move.Geometry, Motion=multiplication_2)  # -> Geometry, Transform
move_3 = Move(Geometry=move_2.Geometry, Motion=multiplication_3)  # -> Geometry, Transform
flip_2 = Flip(Surface=move_3.Geometry)  # -> Surface, Result

# ----
calibrated_work_srf = Surface(move_3.Geometry)

# ---- group: Curves Mapped to Target Surface (continued)
target_surface = Surface(calibrated_work_srf)
map_srf = MapToSurface(Curve=curves_to_draw, Source=source_surface, Target=target_surface)
mapped_curves = Curve(map_srf)

# ---- group: Generate Points from Curves
# Generate Target Planes from Curves
mapped_curves_2 = Curve(mapped_curves)
divdist = DivideDistance(Curve=mapped_curves_2, Distance=Slider(0.75, range=0.01..10))  # -> Points, Tangents, Parameters
lng = ListLength(List=divdist.Points)
startpt = ListItem(List=divdist.Points, Index=0, Wrap=True)
ins = InsertItems(List=divdist.Points, Item=startpt, Indices=lng, Wrap=False)
points_to_draw = Point(divdist.Points)

# ----
intcrv = Interpolate(Vertices=divdist.Points, Degree=1, Periodic=False, KnotStyle=1)  # -> Curve, Length, Domain

# ---- group: Generate Target Planes
points_to_draw_2 = Point(points_to_draw)
target_surface_2 = Surface(target_surface)
srf_cp = SurfaceClosestPoint(Point=points_to_draw_2, Surface=target_surface_2)  # -> Point, UVPoint, Distance
evalsrf = EvaluateSurface(Surface=target_surface_2, Point=srf_cp.UVPoint)  # -> Point, Normal, UDirection, VDirection, Frame
pl = PlaneNormal(Origin=evalsrf.Point, ZAxis=evalsrf.Normal)
target_planes = Plane(pl)

# ---- group: Add Approach & Retract Planes (continued)
target_planes_2 = Plane(target_planes)
lng_2 = ListLength(List=target_planes_2)
endpt = ListItem(List=target_planes_2, Index=expr("x-1", lng_2), Wrap=False)
startpt_2 = ListItem(List=target_planes_2, Index=0, Wrap=True)
approach_plane = PlaneOffset(BasePlane=startpt_2, Offset=number_slider_2)
retract_plane = PlaneOffset(BasePlane=endpt, Offset=number_slider_2)

# ---- group: Combine into Final Set of Target Planes
approach_planes = Plane(approach_plane)
retract_planes = Plane(retract_plane)
target_planes_3 = Plane(target_planes)

# ----
all_target_planes = Plane([approach_planes, target_planes_3, retract_planes])

# ---- group: Visualize Toolpaths
deplane_2 = DeconstructPlane(Plane=all_target_planes)  # -> Origin, XAxis, YAxis, ZAxis
points_3 = PointList(Points=deplane_2.Origin, Size=Slider(8, range=1..100))
intcrv_2 = Interpolate(Vertices=deplane_2.Origin, Degree=1, Periodic=False, KnotStyle=1)  # -> Curve, Length, Domain

# ---- group: Create a Fixed Orientation Plane
xy = XYPlane(Origin=deplane_2.Origin)
pln = Plane(xy)
deplane_3 = DeconstructPlane(Plane=pln)  # -> Origin, XAxis, YAxis, ZAxis

# ---- group: Create a Fixed Orientation Plane / Local X
rot3d_2 = Rotate3D(Geometry=pln, Angle=degrees(Slider(3, range=-360..360)), Center=deplane_3.Origin, Axis=deplane_3.XAxis)  # -> Geometry, Transform

# ---- group: Create a Fixed Orientation Plane / Local Y
rot3d_3 = Rotate3D(Geometry=rot3d_2.Geometry, Angle=degrees(Slider(185, range=-360..360)), Center=deplane_3.Origin, Axis=deplane_3.YAxis)  # -> Geometry, Transform

# ---- group: Create a Fixed Orientation Plane / Local Z
rot3d_4 = Rotate3D(Geometry=rot3d_3.Geometry, Angle=degrees(Slider(207, range=-360..360)), Center=deplane_3.Origin, Axis=deplane_3.ZAxis)  # -> Geometry, Transform

# ---- group: Create a Fixed Orientation Plane (continued)
rotated_planes = Plane(rot3d_4.Geometry)

# ---- group: Combine into Final Set of Target Planes / Toggle TRUE to Lock Orientation to aTarget Plane
c_script = CSharpScript(x=Toggle(True), original_planes=all_target_planes, aligned_planes=rotated_planes)  # -> out, A; inputs x: Boolean, original_planes: list of Plane, aligned_planes: list of Plane
# ---------- c_script: C# ----------
bool val = x;

if (val == false)
{
  A = original_planes;
}
else
{
  A = aligned_planes;
}
# ---------- end c_script ----------

# ----
final_target_planes = Plane(c_script.A)
# Create KRL Program
final_target_planes_2 = Plane(flatten(final_target_planes))

lin_move = LINearMovementKUKAPrc(TargetAsPlane=final_target_planes_2, Speed=".35", extaxenabled=False, interpolation="C_DIS")
lng_3 = ListLength(List=lin_move)
int_2 = Integer(expr("x-1", lng_3))
int_3 = Integer([int, int_2])
ins_2 = InsertItems(List=lin_move, Item=wait, Indices=int_3, Wrap=False)
kuka_prc = KUKAPrcCORE(
    SimulationSlider=knob,
    KUKAPrcCommands=ins_2,
    Tool=custom_tool,
    Robot=kr6_10_r1100,
    SaveToggle=save,
    Filename="arcc_text_1b",
    PRC_BaseExpose=False,
    PRC_SaveNameExpose=True,
    PRCsettings="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")  # -> RobotGeometry, AnalysisOutput

panel = Panel(ins_2)
