# Grasshopper definition KR10_template_routines.gh (Grasshopper 1.0.7)
# plug-ins: KUKA|prc - parametric robot control

geo = Geometry(<brep referenced from the Rhino model>)
save = Button()

# ---- group: Calibrated Plane
# Calibrate Surface Routine
pt = Point(Point(940.36, 0.11, 695.58))
pt_2 = Point(Point(943.56, -314.37, 261.92))
pt_3 = Point(Point(926.01, 462.93, 261.92))

# ----
pt_4 = Point([pt, pt_2, pt_3])

# ---- group: Calibrated Plane (continued)
points = PointList(Points=pt_4, Size=Slider(46, range=1..100))

# ----
pt_5 = Point(pt_4)

# ---- group: Create Oriented Planes
xy = XYPlane(Origin=pt_5)
pln = Plane(xy)
deplane = DeconstructPlane(Plane=pln)  # -> Origin, XAxis, YAxis, ZAxis

# ---- group: Create Oriented Planes / Local X
rot3d = Rotate3D(Geometry=pln, Angle=degrees(Slider(-80, range=-360..360)), Center=deplane.Origin, Axis=deplane.XAxis)  # -> Geometry, Transform

# ---- group: Create Oriented Planes / Local Y
rot3d_2 = Rotate3D(Geometry=rot3d.Geometry, Angle=degrees(Slider(-270, range=-360..360)), Center=deplane.Origin, Axis=deplane.YAxis)  # -> Geometry, Transform

# ---- group: Create Oriented Planes / Local Z
rot3d_3 = Rotate3D(Geometry=rot3d_2.Geometry, Angle=degrees(Slider(-90, range=-360..360)), Center=deplane.Origin, Axis=deplane.ZAxis)  # -> Geometry, Transform

# ----
rotated_planes = Plane(rot3d_3.Geometry)
final_target_planes = Plane(flatten(rotated_planes))

# ----
# Simulation
panel = Panel(".05")
custom_tool = CustomToolKUKAPrc(
    CustomToolGeometry=geo,
    toolid=6,
    toolvala=0,
    toolvalb=0,
    toolvalc=0,
    toolvalx=-89.309,
    toolvaly=11.078,
    toolvalz=137.713,
    valuesset=True)
lin_move = LINearMovementKUKAPrc(TargetAsPlane=final_target_planes, Speed=panel, extaxenabled=False, interpolation="C_DIS")
kr6_10_r1100 = AgilusKR610R1100Robot(infiniterot=False)
knob = ControlKnob(Decimals=2, Limit=True, Maximum=1, Minimum=0, Range=1, Value=0.5)
kuka_prc = KUKAPrcCORE(
    SimulationSlider=knob,
    KUKAPrcCommands=lin_move,
    Tool=custom_tool,
    Robot=kr6_10_r1100,
    SaveToggle=save,
    Filename="calibrate_surface",
    PRC_BaseExpose=False,
    PRC_SaveNameExpose=True,
    PRCsettings="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")  # -> RobotGeometry, AnalysisOutput
